# Grasshopper definition LLUM.gh (Grasshopper 1.0.7)

number_slider = Slider(8.03, range=0..20)
number_slider_2 = Slider(1.74, range=-50..50.01)
pt = ConstructPoint(XCoordinate=number_slider, YCoordinate=number_slider_2, ZCoordinate=Slider(4.99, range=0..10))
pt_2 = ConstructPoint(XCoordinate=number_slider, YCoordinate=number_slider_2, ZCoordinate=Slider(8.52, range=0..20))
vec = VectorXYZ(XComponent=Slider(0, range=0..100), YComponent=Slider(0, range=0..100), ZComponent=Slider(100, range=0..100))  # -> Vector, Length
vec_2 = VectorXYZ(XComponent=Slider(0, range=0..100), YComponent=Slider(0, range=0..100), ZComponent=Slider(100, range=0..100))  # -> Vector, Length
vec2pt = Vector2Pt(PointA=pt_2, PointB=vec.Vector, Unitize=False)  # -> Vector, Length
vec2pt_2 = Vector2Pt(PointA=pt_2, PointB=vec_2.Vector, Unitize=False)  # -> Vector, Length
circle = CircleCNR(Center=pt, Normal=vec2pt_2.Vector, Radius=Slider(1, range=0..5))
circle_2 = CircleCNR(Center=pt_2, Normal=vec2pt.Vector, Radius=Slider(1.5, range=0..5))
number_slider_3 = Slider(20, range=0..50)
pipe = Pipe(Curve=[circle, circle_2], Radius=0.02, Caps=0)
rad = Radians(Degrees=Slider(45, range=0..50))
rotate = Rotate(Geometry=circle, Angle=rad, Plane=circle)  # -> Geometry, Transform
series = Series(Start=0, Step=Slider(1, range=-1..1), Count=Slider(20, range=0..50))
number_slider_4 = Slider(1, range=0..50)
divide = DivideCurve(Curve=rotate.Geometry, Count=number_slider_3, Kinks=False)  # -> Points, Tangents, Parameters
divide_2 = DivideCurve(Curve=circle_2, Count=number_slider_3, Kinks=False)  # -> Points, Tangents, Parameters
graph = GraphMapper(series, x0=0, x1=1, y0=0, y1=1, container_name="Sine", Equation_px=[0, 0.4767792225], Equation_py=[0, 1])
range = Range(Domain=Slider(2, range=0..50), Steps=Slider(17, range=0..50))
division = Division(A=graph, B=Slider(1, range=0..5))
ln = Line(StartPoint=divide.Points, EndPoint=divide_2.Points)
multiplication = Multiplication(A=graph, B=Slider(3, range=0..5))
ext = ExtendCurve(Curve=ln, Type=0, Start=division, End=multiplication)
pipe_2 = Pipe(Curve=ext, Radius=0.1, Caps=0)
panel = Panel(graph)
len = Length(Curve=ext)
panel_2 = Panel(len)
